vi "Initialize app subroutine.gvi"   [LabVIEW NXG 3.1.0]
inputs:
  "Error In": error
outputs:
  "Error Out": error
uses:
  Rainbow Measurement Setup::Main Functions::Initialize App::Instruction Extractor.gvi
  Rainbow Measurement Setup::Main Functions::Instruction Queue::Current State::FGV Current State.gvi
  Rainbow Measurement Setup::Side Functions::Global Abort::FGV Global Abort.gvi
diagram:
  case ($"Error In") {
    frame Error, Default {
      w1 = $"Error In"
    }
    frame No Error {
      call "Instruction Extractor.gvi"(Initialize app subroutine states="Reset Disabled/Enabled Controls", Error In=$"Error In") -> (Initialize app States array=w2, SubStates Output Array=w3, Error Out=w4)
      s1 = w4  # shift register
      for {
        w5 = each element of w2
        w6 = each element of w3
        call "FGV Current State.gvi"(Current State Instructions="Set current Substate", Current Substate=w6, Error In=s1) -> (Error Out=w7)
        case (w5) {
          frame "Reset Disabled/Enabled Controls", Default {
            w8 = _
          }
          frame "Reset Doubles" {
            w8 = _
          }
          frame "Reset Booleans" {
            w8 = _
          }
          frame "Reset Strings" {
            w8 = _
          }
          frame "Reset Global Variables" {
            w8 = _
          }
          frame "Detect Instruments" {
            w8 = w7
          }
        }
        call "FGV Global Abort.gvi"(Global Abort Instructions="Read Current State", Error In=w8) -> (Global Abort Out=w9, Error Out=w10)
        next s1 = w10
        stop if w9
      }
      w1 = s1
    }
  }
  $"Error Out" <- w1
