vi "MSpot Spectrum Calibration Subroutine.gvi"   [LabVIEW NXG 5.0.0]
inputs:
  "Error In": error
outputs:
  "Error Out": error
panel controls:
  "Stand Alone?": bool
  "Instrument Coms Info In": "Instrument Coms Info.gtype"
  "Rainbow Sweep Param Selector": "Rainbow Sweep Param Selector.gtype" = {0, 1100, 300, 1, 1, 0}
  "MSpot Spectrum Calibration Parameters": "MSpot Spectrum Calibration Parameters.gtype" = {"Min Position (mm)"=0, "Max Position (mm)"=10, "Position step size (mm)"=0.1}
  "Load Calibration?": bool
  "Debugging Cluster": "Debugging Cluster.gtype"
panel indicators:
  "Full Beam Multispectral Data Array": "Full MSpot Multispectral Data.gtype"[]
types:
  T1 = cluster{"Element 1": "VISA Instr", "Element 2": string}
  "Arduino Detection cluster control.gtype" = cluster{"XZ Stage Arduino Address": "VISA Instr", "XZ Stage Arduino Detected?": bool, "Multiplexer Arduino Detected?": bool, "Multiplexer Arduino Address": "VISA Instr", "Arduinos List": T1[], "XZ Stage Log": string, "Multiplexer Log": string}
  "Thorlabs Motors Serial Number In.gtype" = cluster{"Thorlabs Blue Motor": string, "Thorlabs Red Motor": string, "Blue Motor Homed?": bool, "Red Motor Homed?": bool}
  "Instrument Coms Info.gtype" = cluster{"Arduino Coms Info": "Arduino Detection cluster control.gtype", "Photodetector Names": string[], "Keythley Address": "VISA Instr", "Photodetector Detected?": bool, "Thorlabs Motors Detected?": bool, "Keithley Detected?": bool, "Thorlabs Motors Serial Number": "Thorlabs Motors Serial Number In.gtype", "Photodetector IVI session": "Ivi IviDefault"}
  "Raibow Sweep Selector.gtype" = enum{"Red Sweep", "Blue Sweep", "Full Sweep Red First", "Full Sweep Blue First"}
  "Rainbow Sweep Type Selector.gtype" = cluster{"Red Sweep Mode": enum{"Red Sweep Closing", "Red Sweep Opening"}, "Blue Sweep Mode": enum{"Blue Sweep Opening", "Blue Sweep Closing"}}
  "Rainbow Sweep Param Selector.gtype" = cluster{"Raibow Sweep Selector": "Raibow Sweep Selector.gtype", "Max Wavelength (nm)": f64, "Min Wavelength (nm)": f64, "Wavelength Step (nm)": f64, "Rainbow Sweep Types": "Rainbow Sweep Type Selector.gtype"}
  "MSpot Spectrum Data.gtype" = cluster{"M Spot Spectrum": cluster{"Wavelength": f64[], "Counts": f64[]}, "Blue Motor Position (mm)": f64, "Red Motor Position (mm)": f64}
  "Rainbow Sweep Types.gtype" = enum{"Red Sweep Closing", "Red Sweep Opening", "Blue Sweep Closing", "Blue Sweep Opening"}
  "Full MSpot Multispectral Data.gtype" = cluster{"MSpot Spectrum Data Array": "MSpot Spectrum Data.gtype"[], "Rainbow Sweep Types": "Rainbow Sweep Types.gtype"}
  "MSpot Spectrum Calibration Parameters.gtype" = cluster{"Min Position (mm)": f64, "Max Position (mm)": f64, "Position step size (mm)": f64}
  "Insturment Debugging Cluster.gtype" = cluster{"Keithley": bool, "Arduinos": bool, "Thorlabs Motors": bool, "Photodetector": bool}
  "Debugging Cluster.gtype" = cluster{"Debugging mode?": bool, "Initialize App": bool, "Insturment Debugging": "Insturment Debugging Cluster.gtype"}
uses:
  Rainbow Measurement Setup::Side Functions::Instrument Control::Debug Cluster Instrument Extractor.gvi
  Rainbow Measurement Setup::Main Functions::One Time Calibrations::Beam Power Density::Specific Detect Instruments Subroutine.gvi
  Rainbow Measurement Setup::Side Functions::Instrument Control::Thorlabs Motors::Movement::KCube Move to 0 or Home.gvi
  Rainbow Measurement Setup::Side Functions::Instrument Control::Arduino::XZ Stage Arduino::XZ Stage Initialize And Home.gvi
  Rainbow Measurement Setup::Side Functions::Instrument Control::Photodetector::Photodetector Initialize.gvi
  Rainbow Measurement Setup::Main Functions::One Time Calibrations::MSpot Spectrum::MSpot Spectrum Rainbow Sweep Subroutine.gvi
  Rainbow Measurement Setup::Side Functions::Instrument Control::Photodetector::Photodetector Close Coms.gvi
  Rainbow Measurement Setup::Side Functions::Instrument Control::Arduino::XZ Stage Arduino::XZ Stage Close Coms.gvi
  Rainbow Measurement Setup::Main Functions::One Time Calibrations::MSpot Spectrum::File Handling::MSpot Spectra file handling.gvi
  Rainbow Measurement Setup::Main Functions::One Time Calibrations::MSpot Spectrum::File Handling::MSpot Load Prompt.gvi
  Rainbow Measurement Setup::Main Functions::One Time Calibrations::MSpot Spectrum::MSpot Spectrum Visualizer.gvi
  Rainbow Measurement Setup::Side Functions::Global Abort::FGV Global Abort.gvi
diagram:
  w1 = $"MSpot Spectrum Calibration Parameters"
  w2 = $"Rainbow Sweep Param Selector"
  w3 = $"Stand Alone?"
  w4 = $"Load Calibration?"
  # This subVI takes a full spectrum for each guillotine motor position and then changes the guillotine position and continues on taking spectra.
  # After all the spectra have been taken we are presented with the results to determine the dividing wavelength for each position and then we can
  # write down the dividing wavelength file.
  # Falta comunicar amb el flame :') DRAMA
  case ($"Error In") {
    frame Error, Default {
      w5 = $"Error In"
      w6 = default
    }
    frame No Error {
      s1 = $"Error In"  # shift register
      s2 = "Start App"  # shift register
      s3 = $"Instrument Coms Info In"  # shift register
      s4 = uninitialised  # shift register
      s5 = $"Debugging Cluster"  # shift register
      while {
        case (s2) {
          frame "Start App", Default {
            Select(s=w3, t="Detect Instruments", f="Initialize Instruments") -> w13
            Select(s=w4, t="Load Calibration", f=w13) -> w7
            w8 = s1
            w9 = s3
            w10 = s4
            w11 = default
            w12 = s5
          }
          frame "Detect Instruments" {
            call "Debug Cluster Instrument Extractor.gvi"(Debugging Cluster In=s5, Error In=s1) -> (Debuging Cluster Out=w12, Instruments to Detect=w14, Error Out=w15)
            call "Specific Detect Instruments Subroutine.gvi"(Instrument Coms Info In=s3, Error In=w15, Instruments To Detect Array=w14, Stand Alone?=w3) -> (Instrument Coms Info Out=w9, Error Out=w8)
            w7 = "Initialize Instruments"
            w10 = s4
            w11 = default
          }
          frame "Initialize Instruments" {
            call "KCube Move to 0 or Home.gvi"(Instrument Coms Info In=s3, Debugging Cluster In=s5, Error In=s1) -> (Instrument Coms Info Out=w16, Debugging Cluster Out=w17, Error Out=w18)
            call "XZ Stage Initialize And Home.gvi"(Instrument Coms Info In=w16, Debugging Cluster In=w17, Error In=w18) -> (Instrument Coms Info Out=w19, Debugging Cluster Out=w20, Error Out=w21)
            call "Photodetector Initialize.gvi"(Instrument Coms Info In=w19, Debugging Cluster In=w20, Error In=w21) -> (Instrument Coms Info Out=w9, Debugging Cluster Out=w12, Error Out=w8)
            w7 = "Rainbow Sweep"
            w10 = s4
            w11 = default
          }
          frame "Rainbow Sweep" {
            call "MSpot Spectrum Rainbow Sweep Subroutine.gvi"(Instrument Coms Info In=s3, MSpot Spectrum Calibration Parameters=w1, Rainbow Sweep Param Selector=w2, Debugging Cluster In=s5, Error In=s1, Manual Input=TRUE) -> (Instrument Coms Info Out=w9, Full MSpot Multispectral Data Array=w10, Debugging Cluster Out=w12, Error Out=w8)
            w7 = "Close Coms"
            w11 = default
          }
          frame "Close Coms" {
            call "Photodetector Close Coms.gvi"(Instrument Coms Info In=s3, Debugging Cluster In=s5, Error In=s1) -> (Instrument Coms Info Out=w22, Debugging Cluster Out=w12, Error Out=w23)
            call "XZ Stage Close Coms.gvi"(Instrument Coms Info In=w22, Error In=w23) -> (Instrument Coms Info Out=w9, Error Out=w8)
            w7 = "Check Graphs"
            w10 = s4
            w11 = default
          }
          frame "Load Calibration" {
            call "MSpot Spectra file handling.gvi"(Full MSpot Multispectral Data Array In=s4, Modify File Operation="Load TXT", Error In=s1) -> (Full MSpot Multispectral Data Array Out=w10, Found Any File?=w24, Error Out=w8)
            call "MSpot Load Prompt.gvi"(Found Any File?=w24, Input=w3) -> (Output=w7)
            w9 = s3
            w11 = default
            w12 = s5
          }
          frame "Check Graphs" {
            case (w4) {
              frame True {
                w7 = "Stop App"
              }
              frame False {
                w25 = "Do you wish to save the current\ncalibration files?\nThey will be saved on the Extra \ninstallers folder."
                Two Button Dialog(F button name ("Cancel")="Oh, don't bother\nI was just testing.", T button name ("OK")="Yes please save \nthe calibration files :D", message=w25) -> (T Button?=w26)
                Select(s=w26, t="Save Graphs", f="Stop App") -> w7
              }
            }
            call "MSpot Spectrum Visualizer.gvi"(Full MSpot Multispectral Data Array=s4, Error In=s1) -> (Error Out=w8)
            w9 = s3
            w10 = s4
            w11 = default
            w12 = s5
          }
          frame "Save Graphs" {
            call "MSpot Spectra file handling.gvi"(Full MSpot Multispectral Data Array In=s4, Modify File Operation="Save TXT", Error In=s1) -> (Full MSpot Multispectral Data Array Out=w10, Error Out=w8)
            w7 = "Stop App"
            w9 = s3
            w11 = default
            w12 = s5
          }
          frame "Stop App" {
            w7 = "Start App"
            w8 = s1
            w9 = s3
            w10 = s4
            w11 = TRUE
            w12 = s5
          }
        }
        call "FGV Global Abort.gvi"(Global Abort Instructions="Read Current State", Error In=w8) -> (Local Abort Out=w27, Global Abort Out=w28, Error Out=w29)
        Logical Or(w27, w28, w11) -> w30
        next s1 = w29
        next s2 = w7
        next s3 = w9
        next s4 = w10
        next s5 = w12
        stop if w30
      }
      w5 = s1
      w6 = s4
    }
  }
  $"Full Beam Multispectral Data Array" <- w6
  $"Error Out" <- w5
