vi "MSpot Spectrum Visualizer.gvi"   [LabVIEW NXG 5.0.0]
inputs:
  "Error In": error
  "Full Beam Multispectral Data Array": "Full Measuring Spot Multispectral Data.gtype"[]
outputs:
  "Error Out": error
panel controls:
  "Sweep Type Selector": i32
  "Graph (position) Selector": i32
  "Continue": bool
panel indicators:
  "Rainbow Sweep Type": "Rainbow Sweep Types.gtype"
  "Beam Spectrum Information": "Measuring Spot Spectrum Data.gtype"
  "Beam Spectrum": cluster{"Element 1": f64[], "Element 2": f64[]}
types:
  "Rainbow Sweep Types.gtype" = enum{"Red Sweep Closing", "Red Sweep Opening", "Blue Sweep Closing", "Blue Sweep Opening"}
  "Measuring Spot Spectrum Data.gtype" = cluster{"Beam Spectrum": cluster{"Wavelength": f64[], "Counts": f64[]}, "Blue Motor Position (mm)": f64, "Red Motor Position (mm)": f64}
  "Full Measuring Spot Multispectral Data.gtype" = cluster{"Beam Spectrum Data Array": "Measuring Spot Spectrum Data.gtype"[], "Rainbow Sweep Types": "Rainbow Sweep Types.gtype"}
diagram:
  Property Node(instance in=reference to unnamed native front panel, error in=$"Error In") -> ("Window"=w1, error out=w2)
  Open Window(reference in=w1, error in=w2) -> (reference out=w3, error out=w4)
  # This subVI allows us to visualize the data obtained on the Measuring Spot Spectrum Calibration subroutine so that we can
  # extract our own conclusions and elaborate the calibration file.
  case (w4) {
    frame Error, Default {
      w5 = w4
    }
    frame No Error {
      while {
        Array Index(array=$"Full Beam Multispectral Data Array") -> (out0[$"Sweep Type Selector"]=w6)
        Property Node(instance in=w6) -> ("Beam Spectrum Data Array"=w7, "Rainbow Sweep Types"=w8)
        Array Index(array=w7) -> (out0[$"Graph (position) Selector"]=w9)
        $"Beam Spectrum Information" <- w9
        Property Node(instance in=w9) -> ("Beam Spectrum"=w10)
        Property Node(instance in=w10) -> ("Wavelength"=w11, "Counts"=w12)
        Build Cluster(w11, w12) -> w13
        $"Beam Spectrum" <- w13
        Wait Until Next Multiple(multiple to wait=50)
        $"Rainbow Sweep Type" <- w8
        stop if $Continue
      }
      w5 = w4
    }
  }
  Close Window(reference in=w3, error in=w5) -> (error out=w14)
  $"Error Out" <- w14
