vi "Light Power Calibration Sweep.gvi"   [LabVIEW NXG 5.0.0]
inputs:
  "Error In": error
  "Instrument Coms Info In": "Instrument Coms Info.gtype"
  "Debugging Cluster In": "Debugging Cluster.gtype"
  "Rainbow Sweep Param Selector": "Rainbow Sweep Param Selector.gtype" = {0, 1100, 300, 1, 1, 0}
outputs:
  "Error Out": error
  "Instrument Coms Info Out": "Instrument Coms Info.gtype"
  "Debugging Cluster Out": "Debugging Cluster.gtype"
  "Light Power Calibration Data": "Light Power Calibration Data.gtype"[]
types:
  "Raibow Sweep Selector.gtype" = enum{"Red Sweep", "Blue Sweep", "Full Sweep Red First", "Full Sweep Blue First"}
  "Rainbow Sweep Type Selector.gtype" = cluster{"Red Sweep Mode": enum{"Red Sweep Closing", "Red Sweep Opening"}, "Blue Sweep Mode": enum{"Blue Sweep Opening", "Blue Sweep Closing"}}
  "Rainbow Sweep Param Selector.gtype" = cluster{"Raibow Sweep Selector": "Raibow Sweep Selector.gtype", "Max Wavelength (nm)": f64, "Min Wavelength (nm)": f64, "Wavelength Step (nm)": f64, "Rainbow Sweep Types": "Rainbow Sweep Type Selector.gtype"}
  "Insturment Debugging Cluster.gtype" = cluster{"Keithley": bool, "Arduinos": bool, "Thorlabs Motors": bool, "Photodetector": bool}
  "Debugging Cluster.gtype" = cluster{"Debugging mode?": bool, "Initialize App": bool, "Insturment Debugging": "Insturment Debugging Cluster.gtype"}
  T1 = cluster{"Element 1": "VISA Instr", "Element 2": string}
  "Arduino Detection cluster control.gtype" = cluster{"XZ Stage Arduino Address": "VISA Instr", "XZ Stage Arduino Detected?": bool, "Multiplexer Arduino Detected?": bool, "Multiplexer Arduino Address": "VISA Instr", "Arduinos List": T1[], "XZ Stage Log": string, "Multiplexer Log": string}
  "Thorlabs Motors Serial Number In.gtype" = cluster{"Thorlabs Blue Motor": string, "Thorlabs Red Motor": string, "Blue Motor Homed?": bool, "Red Motor Homed?": bool}
  "Instrument Coms Info.gtype" = cluster{"Arduino Coms Info": "Arduino Detection cluster control.gtype", "Photodetector Names": string[], "Keythley Address": "VISA Instr", "Photodetector Detected?": bool, "Thorlabs Motors Detected?": bool, "Keithley Detected?": bool, "Thorlabs Motors Serial Number": "Thorlabs Motors Serial Number In.gtype", "Photodetector IVI session": "Ivi IviDefault"}
  T2 = cluster{"Dividing Wavelength Array": f64[], "Measured Power Array": f64[]}
  "Rainbow Sweep Types.gtype" = enum{"Red Sweep Closing", "Red Sweep Opening", "Blue Sweep Closing", "Blue Sweep Opening"}
  "Light Power Calibration Data.gtype" = cluster{"Single Light Calibration": T2, "Rainbow Sweep Types": "Rainbow Sweep Types.gtype"}
uses:
  Rainbow Measurement Setup::Side Functions::Rainbow Sweep::Rainbow Sweep Param Generator.gvi
  Rainbow Measurement Setup::Side Functions::Instrument Control::Thorlabs Motors::Dividing Wavelength Control::Dividing Wavelength Calibration Data FGV.gvi
  Rainbow Measurement Setup::Side Functions::Instrument Control::Thorlabs Motors::Dividing Wavelength Control::KCube Dividing Wavelength Translator.gvi
  Rainbow Measurement Setup::Side Functions::Instrument Control::Photodetector::Photodetector Measure Power.gvi
diagram:
  case ($"Error In") {
    frame Error, Default {
      w1 = $"Error In"
      w2 = default
      w3 = $"Instrument Coms Info In"
      w4 = $"Debugging Cluster In"
    }
    frame No Error {
      call "Rainbow Sweep Param Generator.gvi"(Rainbow Sweep Parameters=$"Rainbow Sweep Param Selector", Error In=$"Error In") -> (Rainbow Sweep Parameters Array=w5, Error Out=w6)
      call "Dividing Wavelength Calibration Data FGV.gvi"(General FGV Instructions="Read State", Error In=w6) -> (Dividing Wavelength Calibration Data Out=w7, Error Out=w8)
      s1 = w8  # shift register
      s2 = $"Instrument Coms Info In"  # shift register
      s3 = $"Debugging Cluster In"  # shift register
      s4 = "Light Power Calibration Data.gtype"[] []  # shift register
      for {
        w9 = each element of w5
        Property Node(instance in=w9) -> ("Dividing Wavelength Array"=w10, "Rainbow Sweep Types"=w11)
        s5 = s2  # shift register
        s6 = s1  # shift register
        s7 = s3  # shift register
        s8 = T2 {all zero or empty}  # shift register
        for (iteration -> i1) {
          w12 = each element of w10
          Property Node(instance in=s8) -> ("Dividing Wavelength Array"=w13, "Measured Power Array"=w14, instance out=w15)
          call "KCube Dividing Wavelength Translator.gvi"(Debugging Cluster=s7, Dividing Wavelength=w12, Instrument Coms Info In=s5, Dividing Wavelength Calibration Data In=w7, Error In=s6, Rainbow Sweep Types=w11) -> (Real Dividing Wavelength=w16, Instrument Coms Info Out=w17, Error Out=w18)
          Insert Into Array(inArray=w13, index0=i1, new=w16) -> w19
          call "Photodetector Measure Power.gvi"(Instrument Coms Info In=w17, Debugging Cluster In=s7, Error In=w18) -> (Instrument Coms Info Out=w20, Debugging Cluster Out=w21, Measured Power=w22, Error Out=w23)
          Insert Into Array(inArray=w14, index0=i1, new=w22) -> w24
          Property Node(instance in=w15, "Dividing Wavelength Array"=w19, "Measured Power Array"=w24) -> (instance out=w25)
          next s5 = w20
          next s6 = w23
          next s7 = w21
          next s8 = w25
        }
        Property Node(instance in="Light Power Calibration Data.gtype" {all zero or empty}, "Single Light Calibration"=s8, "Rainbow Sweep Types"=w11) -> (instance out=w26)
        Insert Into Array(inArray=s4, new=w26) -> w27
        next s1 = s6
        next s2 = s5
        next s3 = s7
        next s4 = w27
      }
      w1 = s1
      w2 = s4
      w3 = s2
      w4 = s3
    }
  }
  $"Debugging Cluster Out" <- w4
  $"Light Power Calibration Data" <- w2
  $"Instrument Coms Info Out" <- w3
  $"Error Out" <- w1
